# Grasshopper definition aritificial reefs generation.gh (Grasshopper 1.0.7)
# plug-ins: Kangaroo2 Components, MeshEdit Components, Weaverbird, Noise

# Don't activate all part at once! It takes lots of time
# Modelling
number_slider = Slider(20, range=0..100)

nozzle_standoff_distance = Slider(10, range=0..100)
nozzle_speed_mm_min = Slider(3000, range=0..8000)

# ----
# Print station
construct_point = ConstructPoint(XCoordinate=0, YCoordinate=0, ZCoordinate=0)
rectangle = Rectangle(Plane=construct_point, XSize="1095", YSize="1095", Radius=number_slider)  # -> Rectangle, Length

division = Division(A="1095", B=2)

unit_x = UnitX(Factor=division)
reverse = Reverse(Vector=unit_x)
move = Move(Geometry=rectangle.Rectangle, Motion=reverse)  # -> Geometry, Transform
unit_y = UnitY(Factor=division)
reverse_2 = Reverse(Vector=unit_y)
move_2 = Move(Geometry=move.Geometry, Motion=reverse_2)  # -> Geometry, Transform
boundary_surfaces = BoundarySurfaces(Edges=move_2.Geometry)

area = Area(Geometry=boundary_surfaces)  # -> Area, Centroid
division_2 = Division(A="700", B="1095")
scale = Scale(Geometry=boundary_surfaces, Center=area.Centroid, Factor=division_2)  # -> Geometry, Transform
curve = Curve(scale.Geometry)
divide_curve = DivideCurve(Curve=curve, Count=Slider(120, range=0..1000), Kinks=False)  # -> Points, Tangents, Parameters
shift_list = ShiftList(List=divide_curve.Points, Shift=1, Wrap=True)
line = Line(StartPoint=divide_curve.Points, EndPoint=shift_list)
shift_list_2 = ShiftList(List=line, Shift=1, Wrap=True)
surface = Surface(scale.Geometry)
length_line = LengthLine(Line=line, Length=Slider(200, range=0..1000), Strength=10)
collider = Collider(Objects=line, Radii=Slider(50, range=0..100), Strength="100")
angle = Angle(LineA=line, LineB=shift_list_2, RestAngle="0", Strength="1000")
mesh_brep = MeshBrep(
    Brep=surface,
    Settings={GridMaxCount=0, GridMinCount=16, JaggedSeams=False, MaxEdgeLength=0, MinEdgeLength=0.0001, MinTolerance=0, Refine=True, RefineAngle=0, RelativeTolerance=0.65, SimplePlanes=True, Tolerance=0})
onmesh = OnMesh(Points=divide_curve.Points, Mesh=mesh_brep, Strength="1000")
solver = Solver(GoalObjects=[onmesh, length_line, collider, angle], Reset=Button(), Threshold=1e-15, Tolerance=0.0001, On=Toggle(True))  # -> I, V, O
nurbs_curve = NurbsCurve(Vertices=solver.V, Degree=3, Periodic=invert(False))  # -> Curve, Length, Domain
range = Range(Domain="1050", Steps=Slider(30, range=0..100))
unit_z = UnitZ(Factor=Slider(120, range=0..1000))
graph_mapper = GraphMapper(
    range,
    x0=0,
    x1=1,
    y0=0,
    y1=1,
    amplitude=0.2681660652,
    container_name="Perlin",
    decay=0.3,
    frequency=0.2283011079,
    x_offset=0.5,
    y_offset=0.5)
extrude = Extrude(Base=curve, Direction=unit_z)
bounds = Bounds(Numbers=graph_mapper)
construct_domain = ConstructDomain(DomainStart=Slider(0.95, range=0..1), DomainEnd=Slider(0.99, range=0..10))
area_2 = Area(Geometry=boundary_surfaces)  # -> Area, Centroid
remap_numbers = RemapNumbers(Value=graph_mapper, Source=bounds, Target=construct_domain)  # -> Mapped, Clipped
scale_2 = Scale(Geometry=nurbs_curve.Curve, Center=area_2.Centroid, Factor=remap_numbers.Mapped)  # -> Geometry, Transform
unit_z_2 = UnitZ(Factor=range)
move_3 = Move(Geometry=scale_2.Geometry, Motion=unit_z_2)  # -> Geometry, Transform
loft = Loft(Curves=move_3.Geometry, Options={Adjust=False, Closed=False, LoftEnds=0, LoftSimp=0, LoftType=0, Rebuild=10, Refit=0.01})

surface_2 = Surface(loft)  # disabled
surface_3 = Surface(surface_2)

# ----
# Noise
panel = Panel("1000")
divide_surface = DivideSurface(Surface=surface_3, UCount=panel, VCount=panel)  # -> flatten(Points), Normals, Parameters
bounding_box = BoundingBox(Content=surface_3, Plane=PlaneXY(0, 0, 0), UnionBox=True)  # -> Box, Box_2
mesh_frompoints = MeshFromPoints(Points=divide_surface.Points, UDirection=expr("x+1", panel), VDirection=expr("x+1", panel))
deconstruct_mesh = DeconstructMesh(Mesh=mesh_frompoints)  # -> Vertices, Faces, Colours, Normals
populate_3d = Populate3D(Region=bounding_box.Box, Count=Slider(300, range=10..1000), Seed=1)
number_slider_2 = Slider(0.1, range=0..1)
panel_2 = Panel("""0: f1
1: f2
2: f1 - f2
3: f3 - f4
4: (f1 - f2) + (f3 - f4)""")

worleynoise = WorleyNoise(Points=deconstruct_mesh.Vertices, Centers=populate_3d, DistanceMetric=0, Seed=Slider(15, range=0..100))  # -> F1, F2, F3, F4

subtraction = Subtraction(A=worleynoise.F3, B=worleynoise.F4)
subtraction_2 = Subtraction(A=worleynoise.F1, B=worleynoise.F2)
addition = Addition(A=subtraction_2, B=subtraction)
multiplication = Multiplication(A=addition, B=number_slider_2)
multiplication_2 = Multiplication(A=subtraction_2, B=number_slider_2)
multiplication_3 = Multiplication(A=subtraction, B=number_slider_2)
multiplication_4 = Multiplication(A=worleynoise.F1, B=number_slider_2)
multiplication_5 = Multiplication(A=worleynoise.F2, B=number_slider_2)
stream_filter = StreamFilter(
    Gate=Slider(2, range=0..5),
    Stream0=multiplication_4,
    Stream1=multiplication_5,
    Stream2=multiplication_2,
    Stream3=multiplication_3,
    Stream4=multiplication)
amplitude = Amplitude(Vector=deconstruct_mesh.Normals, Amplitude=stream_filter)
bounds_2 = Bounds(Numbers=stream_filter)
move_4 = Move(Geometry=deconstruct_mesh.Vertices, Motion=amplitude)  # -> Geometry, Transform
deconstruct_domain = DeconstructDomain(Domain=bounds_2)  # -> Start, End
gradient = Gradient(
    LowerLimit=deconstruct_domain.Start,
    UpperLimit=deconstruct_domain.End,
    Parameter=stream_filter,
    stops=[0: RGB(80, 55, 25), 0.5: RGB(159, 65, 29), 1: RGB(174, 166, 129)])
construct_mesh = ConstructMesh(Vertices=move_4.Geometry, Faces=deconstruct_mesh.Faces, Colours=gradient)
weaverbird_s_catmull_clark_subdivision = WeaverbirdsCatmullClarkSubdivision(MeshCurves=construct_mesh, Level="3", SmoothNakedEdges=1)  # disabled

# ----
# Printing
geometry = Geometry(weaverbird_s_catmull_clark_subdivision)
merge = Merge(Data1=geometry)
unit_z_3 = UnitZ(Factor=nozzle_standoff_distance)
move_5 = Move(Geometry=merge, Motion=unit_z_3)  # -> Geometry, Transform
contour = Contour(Shape=move_5.Geometry, Point=Point(0, 0, 0), Direction=Vector(0, 0, 1), Distance=nozzle_standoff_distance)  # -> flatten(Contours); disabled
curve_2 = Curve(<curve referenced from the Rhino model>)
volume_m_3 = Panel("0.53이 맥스")
volume_m_3_2 = Panel("2번 휴식")

# ----
# Spiralization
point_count = Slider(200, range=20..1000)
construct_domain_2 = ConstructDomain(DomainStart="1", DomainEnd=point_count)
range_2 = Range(Domain=construct_domain_2, Steps=point_count)
division_3 = Division(A=nozzle_standoff_distance, B=point_count)
multiplication_6 = Multiplication(A=range_2, B=division_3)
divide_curve_2 = DivideCurve(Curve=contour, Count=point_count, Kinks=False, UseTasks=False)  # -> Points, Tangents, Parameters
unit_z_4 = UnitZ(Factor=multiplication_6)
move_6 = Move(Geometry=divide_curve_2.Points, Motion=unit_z_4)  # -> Geometry, Transform
polyline = PolyLine(Vertices=flatten(move_6.Geometry), Closed=False)

curve_to_polyline = CurveToPolyline(Curve=polyline, ToleranceDistance=0, ToleranceAngle=degrees("5"))  # -> Polyline, flatten(Segments)
addition_2 = Addition(B=nozzle_standoff_distance)
geometry_2 = Geometry(curve_2)
control_points = ControlPoints(Curve=geometry_2)  # -> Points, Weights, Knots
polyline_2 = PolyLine(Vertices=flatten(control_points.Points), Closed=False)

# ----
# Printing information
point_on_curve = PointOnCurve(polyline_2, parameter=0)
layer_width = Slider(30, range=0..100)
yz_plane = YZPlane(Origin=point_on_curve)
rectangle_2 = Rectangle(Plane=yz_plane, XSize=layer_width, YSize=nozzle_standoff_distance, Radius=0)  # -> Rectangle, Length
division_4 = Division(A=layer_width, B=2)
unit_y_2 = UnitY(Factor=division_4)
reverse_3 = Reverse(Vector=unit_y_2)
move_7 = Move(Geometry=rectangle_2.Rectangle, Motion=reverse_3)  # -> Geometry, Transform
division_5 = Division(A=nozzle_standoff_distance, B=2)
unit_z_5 = UnitZ(Factor=division_5)
reverse_4 = Reverse(Vector=unit_z_5)
move_8 = Move(Geometry=move_7.Geometry, Motion=reverse_4)  # -> Geometry, Transform
boundary_surfaces_2 = BoundarySurfaces(Edges=move_8.Geometry)
area_3 = Area(Geometry=boundary_surfaces_2)  # -> Area, Centroid
length = Length(Curve=curve_2)
multiplication_7 = Multiplication(A=length, B=area_3.Area)
panel_3 = Panel(length)
volume = Panel(multiplication_7)
mass_addition = MassAddition(Input=flatten(panel_3))  # -> Result, PartialResults
mass_addition_2 = MassAddition(Input=flatten(volume))  # -> Result, PartialResults
division_6 = Division(A=mass_addition.Result, B=nozzle_speed_mm_min)
multiplication_8 = Multiplication(A=mass_addition_2.Result, B=1e-09)
printing_time_min = Panel(division_6)
volume_m_3_3 = Panel(multiplication_8)

control_points_2 = ControlPoints(Curve=polyline_2)  # -> Points, Weights, Knots

# ----
# G-code
deconstruct = Deconstruct(Point=flatten(control_points_2.Points))  # -> XComponent, YComponent, ZComponent
concatenate = Concatenate(
    FragmentH="G1",
    FragmentG=" F",
    FragmentI=nozzle_speed_mm_min,
    FragmentA=" X",
    FragmentB=deconstruct.XComponent,
    FragmentC=" Y",
    FragmentD=deconstruct.YComponent,
    FragmentE=" Z",
    FragmentF=deconstruct.ZComponent)
panel_4 = Panel("""G90
M08""")
merge_2 = Merge(Data1=flatten(panel_4), Data2=flatten(concatenate))
g_code = Panel(merge_2)  # disabled
